# Grasshopper definition 4 Import OSM.gh (Grasshopper 1.0.8)
# plug-ins: Heron

# ----
# READ FILE
path = FilePath("C:\Users\VincentNowak\Dropbox\UCL RC15 Skills 2025\PervasiveUrbanism_25-26\Skills Module 1 Cartographies of Affect\Skills 1 - Day 3 Geodata in Grasshopper\0. Importing Text Files\004RC16S.CSV")
file = ReadFile(File=path, PerLineParse=True)
panel = Panel(file)
cull_i = CullIndex(List=file, Indices="0", Wrap=True)
tab = Panel("\t")
split = TextSplit(Text=cull_i, Separators=tab)
panel_2 = Panel(split)
item = ListItem(List=split, Index="3", Wrap=True)  # -> Item, Item1

flatten = FlattenTree(Tree=item.Item, Path="{0}")
flatten_2 = FlattenTree(Tree=item.Item1, Path="{0}")
ddtoxy = DecimalDegreesToXY(Latitude=flatten, Longitude=flatten_2)  # -> XyPoint, Transform
panel_3 = Panel(ddtoxy.XyPoint)
panel_4 = Panel("""1551
2191""")
cull_i_2 = CullIndex(List=ddtoxy.XyPoint, Indices=panel_4, Wrap=True)
points = PointList(Points=cull_i_2, Size="1")

lat = Panel("51.547143413134414")
# CONVERT COORDINATES
long = Panel("-0.02326455792985868")
# SET ANCHOR POINT
toggle = BooleanToggle(True)
seteap = SetEarthAnchorPoint(SetEAP=toggle, Latitude=lat, Longitude=long)

# ----
# IMPORT AND FILTER OSM
# Field values of OSM are here:
# https://wiki.openstreetmap.org/wiki/Map_features
# you can test example values here:
# https://www.openstreetmap.org/node/6429327326
# 
# The format is
# [Key],[Value]
filterfiields = Panel("natural")
path_2 = FilePath("C:\Users\VincentNowak\Dropbox\UCL RC15 Skills 2025\PervasiveUrbanism_25-26\Skills Module 1 Cartographies of Affect\Skills 1 - Day 3 Geodata in Grasshopper\1. OpenStreetMap (OSM)\map.osm")
geo = Geometry(<curve referenced from the Rhino model>)
panel_5 = Panel("addr:postcode,SE1 7ND")
panel_6 = Panel("amenity,cafe")
importosm = ImportOSM(Boundary=geo, OSMDataLocation=path_2, Clipped=True)  # -> Extents, Fields, Values, FeatureGeometry, Buildings
filterfieldvalue = Panel("natural,tree")

filterfieldvalue_2 = Panel("[Key],[Value]")
